# Grasshopper definition parallel_finish.gh (Grasshopper 1.0.7)

# ----
# Set overlap:
overlap = Slider(73, range=20..90)

# ----
# Click to save
button = Button()

# ----
# Set cut speed:
cut_speed_mm_sec = Slider(1600, range=100..4600)

# ----
# Set Z axis safe offset:
z_safe_mm = Slider(4, range=0..10)

# ----
# Click to preview path:
toggle = BooleanToggle(True)

# ----
# Select your tool diameter:
value_list = ValueList({"1/4''": 6.35, "1/8''": 3.175, "6mm": 6, "8mm": 8, "1/2''": 12.7}, selected="1/4''")

# ----
# Select your design (Mesh or Brep not both!):
# Right click on 'Brep'->Set One Brep
# Or:
# Right click on 'Mesh'->Set One Mesh
brep = Brep(<brep referenced from the Rhino model>)
mesh = Mesh()

# ----
# Parallel Finish Program
program = Program(
    mesh=mesh,
    save=button,
    brep=brep,
    toold=value_list,
    overlap=overlap,
    cut_speed=cut_speed_mm_sec,
    safe_z=z_safe_mm,
    preview=toggle)

# ==== cluster Program
mesh = ClusterInput()
brep = ClusterInput()
toold = ClusterInput()
overlap = ClusterInput()
cut_speed = ClusterInput()
safe_z = ClusterInput()

mesh_2 = Mesh(mesh)
pathresulution = Slider(1, range=0.1..20)
brep_2 = Brep(brep)
toold_2 = Number(toold)
overlap_2 = Number(overlap)
safe_z_2 = Number(safe_z)
cut_speed_2 = Number(cut_speed)

mesh_3 = MeshBrep(
    Brep=brep_2,
    Settings={GridMaxCount=0, GridMinCount=16, JaggedSeams=False, MaxEdgeLength=0, MinEdgeLength=0.0001, MinTolerance=0, Refine=True, RefineAngle=0, RelativeTolerance=0.65, SimplePlanes=True, Tolerance=0})
move_to_origin_0_0_0 = BooleanToggle(False)  # disabled
crv = Curve()
mesh_4 = Mesh([mesh_2, mesh_3])
weld = WeldMesh(Mesh=mesh_4, Angle=3.141592654)

subtraction = Subtraction(A=100, B=overlap_2)
division = Division(A=subtraction, B=100)
mmdistance = Multiplication(ToolD=toold_2, B=division)

mesh_5 = Mesh(weld)
bbox = BoundingBox(Content=flatten(mesh_5), Plane=PlaneXY(0, 0, 0))  # -> Box, Box_2
box_corners = BoxCorners(Box=bbox.Box)  # -> CornerA, CornerB, CornerC, CornerD, CornerE, CornerF, CornerG, CornerH

boxprop = BoxProperties(Box=bbox.Box)  # -> Center, Diagonal, Area, Volume, Degeneracy
xy = XYPlane(Origin=Point(0, 0, 0))
pl_origin = PlaneOrigin(Base=xy, Origin=boxprop.Center)

move = ClusterInput()

# ----
# half baked ideas
engage_speed_mm_sec = Slider(700, range=100..1000)
retract_speed_mm_sec = Slider(700, range=100..1000)
machining_angle = Slider(0, range=0..90)
python = GhPythonScript(move=move, t=box_corners.CornerE, brep=brep_2)  # -> out, a; disabled
# ---------- python: Python ----------
__author__ = "sharan"
__version__ = "2020.11.06"

import rhinoscriptsyntax as rs

if(move):
    t=rs.coerce3dvector(t)*-1
    a=rs.MoveObject(brep,t)
# ---------- end python ----------

# ----
# scan direction:
# can be either X or Y or both
scany = BooleanToggle(False)
scanx = BooleanToggle(True)
scanx_2 = Boolean(scanx)
scany_2 = Boolean(scany)

Z = UnitZ(Factor=1)
pygrid = GhPythonScript(
    a=box_corners.CornerE,
    b=box_corners.CornerG,
    xDist=pathresulution,
    yDist=pathresulution,
    pitch=mmdistance,
    direction=Z,
    scanX=scanx_2,
    scanY=scany_2,
    toolD=toold_2)  # -> out, pts; inputs a: Point3d, b: Point3d, direction: Vector3d, scanX: Boolean, scanY: Boolean
# ---------- pygrid: Python ----------
__author__ = "sharan"
__version__ = "2020.07.05"

import rhinoscriptsyntax as rs
import ghpythonlib.treehelpers as th

def frange(start, stop=None, step=None):
    # if stop and step argument is None set start=0.0 and step = 1.0
    start = float(start)
    if stop == None:
        stop = start + 0.0
        start = 0.0
    if step == None:
        step = 1.0
        
    count = 0
    while True:
        temp = float(start + count * step)
        if step > 0 and temp >= stop:
            break
        elif step < 0 and temp <= stop:
            break
        yield temp
        count += 1

#bounding box info
xMin=a[0]
xMax=b[0]
yMin=a[1]
yMax=b[1]
z=a[2]

if(xDist==None):
    xDist=1
if(yDist==None):
    yDist=1
    
points=[]
if (scanX):# create a grid oriented along x axis
    for y in frange((yMin),(yMax+pitch),(pitch)):
        tmp=[]
        for x in frange((xMin),(xMax+xDist),(xDist)):
            tmp.append(rs.AddPoint(x,y,z))
        points.append(tmp)



if (scanY):# create a grid oriented along y axis
    for x in frange((xMin),(xMax+pitch),(pitch)):
        
        tmp=[]
        for y in frange((yMin),(yMax+yDist),(yDist)):
            tmp.append(rs.AddPoint(x,y,z))
        points.append(tmp)


pts = th.list_to_tree(points)
# ---------- end pygrid ----------

rad = Radians(Degrees=machining_angle)
rotate = Rotate(Geometry=pygrid.pts, Angle=rad, Plane=pl_origin)  # -> Geometry, Transform

project = ProjectPoint(Point=rotate.Geometry, Direction=Vector(0, 0, -1), Geometry=mesh_5)  # -> Point, Index
pyrmvnull = GhPythonScript(P=project.Point)  # -> out, pts; inputs P: tree
# ---------- pyrmvnull: Python ----------
"""remove null points
null values separate sequence of points 
that should be kept as a separate branch
    Inputs:
        P: tree of projected path points
    Output:
        pts: tree of projected path points

        """

__author__ = "sharan"
__version__ = "2020.11.05"

import rhinoscriptsyntax as rs
import ghpythonlib.treehelpers as th

#tranform tree to list of lists
P= th.tree_to_list(P) 


pts=[]


#for each line of points and normals
for i,line in enumerate(P):
    a=b=None #indices to begin and end of a sequence
    tmp=[]
    for j,p in enumerate(line):
        if(p):
            if(a==None): 
                a=j
            tmp.append(p)
        else:
            if(a): # we just finished going through a seq
                b=j #now we have the domain of valid points
                if(tmp):
                   pts.append(tmp)
                tmp=[]
            else:
                continue    

pts= th.list_to_tree(pts)
# ---------- end pyrmvnull ----------
meshcp = MeshClosestPoint(Point=pyrmvnull.pts, Mesh=mesh_5)  # -> Point, Index, Parameter

facen = FaceNormals(Mesh=mesh_5)  # -> Centers, Normals; disabled
item = ListItem(List=facen.Normals, Index=meshcp.Index, Wrap=True)

pyflipv = GhPythonScript(N=item)  # -> out, normals; inputs N: tree
# ---------- pyflipv: Python ----------
"""if a vector points down (z is negative ) 
multiply by -1
    Inputs:
        N: normals
    Output:
        normals: same vectors all with positive Z """

__author__ = "sharan"
__version__ = "2020.11.06"

import rhinoscriptsyntax as rs
import ghpythonlib.treehelpers as th

Z=2
#tranform tree to list of lists
normals= th.tree_to_list(N) 
#normals=[]
for i,section in enumerate(normals):
     for j,v in enumerate(section):
         if v[Z]<0:
             normals[i][j]=-v
normals= th.list_to_tree(normals)
# ---------- end pyflipv ----------
vec = Vector(pyflipv.normals)
devec = DeconstructVector(Vector=vec)  # -> XComponent, YComponent, ZComponent
vec_2 = VectorXYZ(XComponent=devec.XComponent, YComponent=0, ZComponent=0)  # -> Vector, Length
pt = Point(meshcp.Point)
multiplication = Multiplication(A=vec_2.Vector)
post_to = ValueList({"Mach3 mm": 1, "ShopBot inch": 2}, selected="Mach3 mm")
move_2 = Move(Geometry=pt, Motion=multiplication)  # -> Geometry, Transform

# ----
# this point collection holds the points
#  after offset using the normal
# but for now suspended because
#  of an unresolved bug
pt_2 = Point(move_2.Geometry)

preview = ClusterInput()
save = ClusterInput()
prune = PruneTree(Tree=pyrmvnull.pts, Minimum=2, Maximum=0)
pyconnectcrv = GhPythonScript(pts=prune, safeZ=safe_z_2)  # -> out, pathPts; inputs pts: tree of Point3d
# ---------- pyconnectcrv: Python ----------
"""Provides a scripting component.
    Inputs:
        pts: a tree of points, each branch represents a curve to be milled
        safeZ: hight to go to between every 2 curves
    Output:
        pathPts: one long list of points for the gcode generator"""

__author__ = "sharan"
__version__ = "2020.11.05"

import rhinoscriptsyntax as rs
#import ghpythonlib.treehelpers as th

#tranform tree to list of lists
ptList = []
for i in range(pts.BranchCount):
    branchList = list(pts.Branch(i))
    ptList.append(branchList)

pts=ptList

#get all starting and ending points
starts=[]
ends=[]
for i in range(len(pts)):

    starts.append(rs.coerce3dpoint(rs.AddPoint(pts[i][0])))
    ends.append(rs.coerce3dpoint(rs.AddPoint(pts[i][-1])))
    


#creat start point above origin
p0=rs.AddPoint(0,0,safeZ)
pathPts=[] 
pathPts.append(p0)

#find closest start to start(or end) points order 
#optimize curve linking
for i in range(len(pts)):
    ds=de=idStart=idEnd=-1
    
    #find the closest end point (could be start or end of a curve)
    results=rs.PointCloudClosestPoints(starts,[p0],10000)
    if(results and results[0]):
        idStart=results[0][0]
        ds=rs.Distance(p0,starts[idStart])
    results=rs.PointCloudClosestPoints(ends,[p0],10000)
    if(results and results[0]):
        idEnd=results[0][0]
        de=rs.Distance(p0,ends[idEnd])

    
    if(ds<de) : #if the closest start is closer than the closest end
        #creat the safeZ approach point
        p1=starts.pop(idStart)
        p1.Z=safeZ
        pathPts.append(p1) #add the approach point p1 to the path
        pathPts += pts.pop(idStart) #add all the path points along the curve
        #creat the safeZ retract point
        p0=ends.pop(idStart)
        p0.Z=safeZ
        pathPts.append(p0)#add the retract point p0 to the path
        
    else: #the closest point is an end of curve
        p1=ends.pop(idEnd)
        p1.Z=safeZ
        pathPts.append(p1)
        crv=pts.pop(idEnd)
        crv.reverse() #since we go from the end to the start
        pathPts += crv
        p0=starts.pop(idEnd)
        p0.Z=safeZ
        pathPts.append(p0)
# ---------- end pyconnectcrv ----------
pt_3 = Point(pyconnectcrv.pathPts)

pypreview = GhPythonScript(pts=pt_3, cutSpeed=cut_speed_2, preview=preview)  # -> out, crv, s, e, length, time; inputs pts: list, preview: Boolean
# ---------- pypreview: Python ----------
__author__ = "zoran"
__version__ = "2020.08.21"

import rhinoscriptsyntax as rs

if(preview):
    crv=rs.AddPolyline(pts)
    length=int(rs.CurveLength(crv))
    e=rs.CurveEndPoint(crv)
    s=rs.CurveStartPoint(crv)
    time=int(length/cutSpeed)
# ---------- end pypreview ----------
pywritegcode = GhPythonScript(points=pt_3, save=save, cutSpeed=cut_speed_2, post=post_to, safeZ=safe_z_2)  # -> out, safeZmm, safeZ_inch; inputs points: list of Point3d, save: Boolean
# ---------- pywritegcode: Python ----------
"""Provides a scripting component.
    Inputs:
        points: gcode path as points
        save: bool save or not
        cutSpeed: feedrate in mm/sec (even if shopbotInch)
        filepath: save location
        post: mach3mm/shopBotInch
    Output:
        a: The a output variable"""
                        
import rhinoscriptsyntax as rs
#import os.path
#from os import path 
                
inchFeedrate=str((cutSpeed/60)*0.0393701) #move to inchs/sec
shopBotHeader= "IF %(25)=1 THEN GOTO UNIT_ERROR  \'check to see software is set to standard\n"
shopBotHeader+="SA \'Set program to absolute coordinate mode\n"
shopBotHeader+="CN, 90\n"
shopBotHeader+="&PWSafeZ = 0.300\n"
shopBotHeader+="&PWMaterial = 0.320\n"
shopBotHeader+="&Tool =1     \'Tool number to change to"
shopBotHeader+="C9     \'Change tool\n"
shopBotHeader+="TR,12000    \'Set spindle RPM\n"
shopBotHeader+="C6   \'Spindle on\n"
shopBotHeader+="PAUSE 2\n"
shopBotHeader+="MS,"+inchFeedrate+","+inchFeedrate+"   \t\'sets move speed (feedrate) inch/sec 1st argument is xy speed the 2nd is z speed\n"
shopBotHeader+="JZ,"+str(safeZ*0.0393701)+"   \t\'###jog to safeZ\n"
shopBotHeader+="J2,0.000000,0.000000  \t\'###Jog 2D to origin"                        
shopBotFooter= "JZ,"+str(safeZ*0.0393701)+"\n"
shopBotFooter+= "C7 \t\'Turning router OFF\n"
shopBotFooter+= "END\n"
shopBotFooter+= "UNIT_ERROR:\n"
shopBotFooter+= "CN, 91   'Run file explaining unit error\n"
shopBotFooter+= "END"
                        
mach3Header = "G00 G49 G40.1 G17 G80 G50 G90\n" 
mach3Header+= "G21\n"
mach3Header+= "M6 T0\n"
mach3Header+= "M03 S20000\n"
mach3Header+= "G00 Z"+str(safeZ)+"\n"                       
mach3Footer = "F100\n"
mach3Footer+= "G00 Z"+str(safeZ)+"\n"
mach3Footer+= "M5 M9\n"
mach3Footer+= "M30"
                        
safeZ_inch=safeZ*0.0393701
safeZmm=safeZ                  
minZ_inch=99999
minZmm=99999
                        
shopBot=False #by default post to mach3 mm
if(post=="ShopBot_inch"):
    shopBot=True
                        
                            
if(save):
    s=""
    if(shopBot):
        #filepath+=".sbp"
        s += shopBotHeader+"\n"
        p0=points[0]*0.0393701 #move to inchs
        s += "J3," + str(p0[0])+ ", " + str(p0[1])+ ", " + str(p0[2])+"\n"
        for p in points:
            p=p*0.0393701 #move to inchs
            if(p[2]<minZ_inch): minZ_inch=p[2]
            s += "M3," + str(p[0])+ ", " + str(p[1])+ ", " + str(p[2])+"\n"
                                
        s += shopBotFooter
        filepath = rs.OpenFileName("Save As", "ShopBot Files (*.sbp)|*.sbp|All Files (*.*)|*.*||",filename="ShopBot_horizontal_rough_",extension=".sbp")
        
    else: #mach3 post
        #filepath+=".txt"
        s += mach3Header+"\n"
        s += "G01 Z0.5  F" + str(cutSpeed) +"\n"
        for p in points:
            if(p[2]<minZmm): minZmm=p[2]
            s += "X" + str(p[0]) + " Y" + str(p[1]) + " Z" + str(p[2])+"\n"
                                
        s += mach3Footer
        
        filepath = rs.OpenFileName("Save As", "Text Files (*.txt)|*.txt|All Files (*.*)|*.*||",filename="Mach3_horizontal_rough_",extension=".txt")
                        
                            
                           
    
    #filepath = rs.OpenFileName("Save As", "Text Files (*.txt)|*.txt|All Files (*.*)|*.*||",filename=" mach3_horizontal_rough_",extension=".txt")
    f=open(filepath,"w")
    f.write(s)
    f.close()
    a="all went ok!"        
                        
                
else: 
    a="save is disabled- nothing saved"
# ---------- end pywritegcode ----------
panel = Panel(pywritegcode.safeZmm)
panel_2 = Panel(pywritegcode.safeZ_inch)
