# Grasshopper definition spiral_finish.gh (Grasshopper 1.0.7)

# ----
# Click to save
button = Button()

# ----
# Set Overlap:
overlap = Slider(90, range=20..90)

# ----
# Set cut speed:
cut_speed_mm_sec = Slider(1600, range=100..2000)

# ----
# Click to preview path
toggle = BooleanToggle(True)

# ----
# Set Z axis safe offset:
z_safe_mm = Slider(12, range=1..41)

# ----
# Select your tool diameter:
value_list = ValueList({"1/4''": 6.35, "1/8''": 3.175, "6mm": 6, "8mm": 8}, selected="1/4''")

# ----
# Select your design:
# Right click on 'Brep'->Set One Brep
brep = Brep(<brep referenced from the Rhino model>)

# ----
# Spiral Finish Program
add_pass_on_edge = ValueList({"Yes": True, "No": False}, selected="Yes")
program = Program(
    P=add_pass_on_edge,
    brep=brep,
    save=button,
    diameter=value_list,
    overlap=overlap,
    cutspeed=cut_speed_mm_sec,
    safez=z_safe_mm,
    preview=toggle)

# ==== cluster Program
overlap = ClusterInput()  # Overlap
brep = ClusterInput()
diameter = ClusterInput()  # Diameter
cutspeed = ClusterInput()
safez = ClusterInput()
brep_2 = Brep(brep)

# ----
# toolD calc
expression = Expression(x=diameter, y=overlap, Expression="((100-y)/100)*x")

cutspeed_2 = Number(cutspeed)
safez_2 = Number(safez)

# ----
# r(2pi) = d =>  d=k*2Pi
# 
# k=d/2pi
_2pi = Pi(Factor=2)
division = Division(ToolD=expression, B=_2pi)

bbox = BoundingBox(Content=brep_2, Plane=PlaneXY(0, 0, 0))  # -> Box, Box_2
boxprop = BoxProperties(Box=bbox.Box)  # -> Center, Diagonal, Area, Volume, Degeneracy
pdecon = Deconstruct(Point=boxprop.Diagonal)  # -> XComponent, YComponent, ZComponent
expression_2 = Expression(x=pdecon.XComponent, y=pdecon.YComponent, Expression="If(x>y, x*0.55, y*0.55)")

step_rad = Slider(0.163, range=0..1)
edges = BrepEdges(Brep=brep_2)  # -> Naked, Interior, NonManifold
python = GhPythonScript(maxR=expression_2, step=step_rad, toolD=expression)  # -> out, a
# ---------- python: Python ----------
"""Provides a scripting component.
    Inputs:
        maxR: the total radius of the requirerd spiral 
        step: angular step of the series of points
        toolD: the required distance between tool path passes (combination of tool diameter and overlap)
        
    Output:
        a: num of items in the series
        
to complete one loop we need 2Pi/step points. 

in each loop R grows toolD mm

=> num loops= maxR/toolD

numsteps=numloops *points per loop = (maxR/toolD) *(2Pi/Step) 

"""

__author__ = "sharan"
__version__ = "2019.11.24"

#import rhinoscriptsyntax as rs

Pi=3.14159265359
a=round((maxR/toolD)*(2*Pi/step))
# ---------- end python ----------
join = JoinCurves(Curves=edges.Naked, Preserve=False)
P = ClusterInput()
cull = CullPattern(List=join, CullPattern=P)

series_theta = Series(Start=0, Step=step_rad, Count=python.a)
sin = Sine(Value=series_theta)
R = Multiplication(A=division, B=series_theta)
cos = Cosine(Value=series_theta)
X = Multiplication(A=R, B=cos)
Y = Multiplication(A=R, B=sin)
vec = VectorXYZ(XComponent=X, YComponent=Y, ZComponent=0)  # -> Vector, Length
nurbs = NurbsCurve(Vertices=vec.Vector, Degree=3, Periodic=False)  # -> Curve, Length, Domain

move = Move(Geometry=nurbs.Curve, Motion=boxprop.Center)  # -> Geometry, Transform
project = Project(Curve=move.Geometry, Brep=brep_2, Direction=Vector(0, 0, 1))
unify_lines = UnifyLines(crv=[cull, project], num=safez_2)  # -> C, S, E
crv = Curve(unify_lines.C)
pt = Point(unify_lines.E)
pt_2 = Point(unify_lines.S)
divlength = DivideLength(Curve=crv, Length=0.5)  # -> Points, Tangents, Parameters
pt_3 = Point(divlength.Points)
post_to = ValueList({"Mach3 mm": 1, "ShopBot inch": 2}, selected="Mach3 mm")
preview = ClusterInput()
save = ClusterInput()

pypreview = GhPythonScript(pts=pt_3, cutSpeed=cutspeed_2, preview=preview)  # -> out, crv, s, e, length, time; inputs pts: list, preview: Boolean
# ---------- pypreview: Python ----------
__author__ = "zoran"
__version__ = "2020.08.21"

import rhinoscriptsyntax as rs

if(preview):
    crv=rs.AddPolyline(pts)
    length=int(rs.CurveLength(crv))
    e=rs.CurveEndPoint(crv)
    s=rs.CurveStartPoint(crv)
    time=int(length/cutSpeed)
# ---------- end pypreview ----------
pywritegcode = GhPythonScript(points=pt_3, save=save, cutSpeed=cutspeed_2, post=post_to, safeZ=safez_2)  # -> out, safeZmm, safeZ_inch; inputs points: list of Point3d, save: Boolean
# ---------- pywritegcode: Python ----------
"""Provides a scripting component.
    Inputs:
        points: gcode path as points
        save: bool save or not
        cutSpeed: feedrate in mm/sec (even if shopbotInch)
        filepath: save location
        post: mach3mm/shopBotInch
    Output:
        a: The a output variable"""
                        
import rhinoscriptsyntax as rs
#import os.path
#from os import path 
                
inchFeedrate=str((cutSpeed/60)*0.0393701) #move to inchs/sec
shopBotHeader= "IF %(25)=1 THEN GOTO UNIT_ERROR  \'check to see software is set to standard\n"
shopBotHeader+="SA \'Set program to absolute coordinate mode\n"
shopBotHeader+="CN, 90\n"
shopBotHeader+="&PWSafeZ = 0.300\n"
shopBotHeader+="&PWMaterial = 0.320\n"
shopBotHeader+="&Tool =1     \'Tool number to change to"
shopBotHeader+="C9     \'Change tool\n"
shopBotHeader+="TR,12000    \'Set spindle RPM\n"
shopBotHeader+="C6   \'Spindle on\n"
shopBotHeader+="PAUSE 2\n"
shopBotHeader+="MS,"+inchFeedrate+","+inchFeedrate+"   \t\'sets move speed (feedrate) inch/sec 1st argument is xy speed the 2nd is z speed\n"
shopBotHeader+="JZ,"+str(safeZ*0.0393701)+"   \t\'###jog to safeZ\n"
shopBotHeader+="J2,0.000000,0.000000  \t\'###Jog 2D to origin"                        
shopBotFooter= "JZ,"+str(safeZ*0.0393701)+"\n"
shopBotFooter+= "C7 \t\'Turning router OFF\n"
shopBotFooter+= "END\n"
shopBotFooter+= "UNIT_ERROR:\n"
shopBotFooter+= "CN, 91   'Run file explaining unit error\n"
shopBotFooter+= "END"
                        
mach3Header = "G00 G49 G40.1 G17 G80 G50 G90\n" 
mach3Header+= "G21\n"
mach3Header+= "M6 T0\n"
mach3Header+= "M03 S20000\n"
mach3Header+= "G00 Z"+str(safeZ)+"\n"                       
mach3Footer = "F100\n"
mach3Footer+= "G00 Z"+str(safeZ)+"\n"
mach3Footer+= "M5 M9\n"
mach3Footer+= "M30"
                        
safeZ_inch=safeZ*0.0393701
safeZmm=safeZ                  
minZ_inch=99999
minZmm=99999
                        
shopBot=False #by default post to mach3 mm
if(post=="ShopBot_inch"):
    shopBot=True
                        
                            
if(save):
    s=""
    if(shopBot):
        #filepath+=".sbp"
        s += shopBotHeader+"\n"
        p0=points[0]*0.0393701 #move to inchs
        s += "J3," + str(p0[0])+ ", " + str(p0[1])+ ", " + str(p0[2])+"\n"
        for p in points:
            p=p*0.0393701 #move to inchs
            if(p[2]<minZ_inch): minZ_inch=p[2]
            s += "M3," + str(p[0])+ ", " + str(p[1])+ ", " + str(p[2])+"\n"
                                
        s += shopBotFooter
        filepath = rs.OpenFileName("Save As", "ShopBot Files (*.sbp)|*.sbp|All Files (*.*)|*.*||",filename="ShopBot_horizontal_rough_",extension=".sbp")
        
    else: #mach3 post
        #filepath+=".txt"
        s += mach3Header+"\n"
        s += "G01 Z0.5  F" + str(cutSpeed) +"\n"
        for p in points:
            if(p[2]<minZmm): minZmm=p[2]
            s += "X" + str(p[0]) + " Y" + str(p[1]) + " Z" + str(p[2])+"\n"
                                
        s += mach3Footer
        
        filepath = rs.OpenFileName("Save As", "Text Files (*.txt)|*.txt|All Files (*.*)|*.*||",filename="Mach3_horizontal_rough_",extension=".txt")
                        
                            
                           
    
    #filepath = rs.OpenFileName("Save As", "Text Files (*.txt)|*.txt|All Files (*.*)|*.*||",filename=" mach3_horizontal_rough_",extension=".txt")
    f=open(filepath,"w")
    f.write(s)
    f.close()
    a="all went ok!"        
                        
                
else: 
    a="save is disabled- nothing saved"
# ---------- end pywritegcode ----------
panel = Panel(pywritegcode.safeZmm)
panel_2 = Panel(pywritegcode.safeZ_inch)

# ==== cluster UnifyLines
crv = ClusterInput()
num = ClusterInput()
crv_2 = Curve(crv)
num_2 = Number(num)
num_3 = Number(num_2)
Z = UnitZ(Factor=num_3)

# ----
# if curve is closed break
# it to get a seperate start
#  and end
cls = Closed(Curve=crv_2)  # -> Closed, Periodic
dispatch = Dispatch(List=crv_2, DispatchPattern=cls.Closed)  # -> ListA, ListB

# ----
# if curve end points are too close
# seperate start  and end a bit
end = EndPoints(Curve=dispatch.ListB)  # -> Start, End
vec2pt = Vector2Pt(PointA=end.Start, PointB=end.End, Unitize=False)  # -> Vector, Length
smaller = SmallerThan(FirstNumber=vec2pt.Length, SecondNumber=0.002)  # -> SmallerThan, OrEqualTo
dispatch_2 = Dispatch(List=dispatch.ListB, DispatchPattern=smaller.OrEqualTo)  # -> ListA, ListB

ext = ExtendCurve(Curve=[dispatch_2.ListA, dispatch.ListA], Type=0, Start=0, End=-0.002)

crv_3 = Curve([ext, dispatch_2.ListB])
join = JoinCurves(Curves=crv_3, Preserve=False)
end_2 = EndPoints(Curve=join)  # -> Start, End
devec = DeconstructVector(Vector=end_2.Start)  # -> XComponent, YComponent, ZComponent
sort = SortList(Keys=devec.YComponent, ValuesA=join)  # -> Keys, flatten(ValuesA)
end_3 = EndPoints(Curve=sort.ValuesA)  # -> Start, End

lng = ListLength(List=end_3.End)
expression = Expression(x=lng, Expression="if((x%2 = 1 ),(x-1),x)")
cull_i = CullIndex(List=end_3.End, Indices=expression, Wrap=False)

cull_i_2 = CullIndex(List=end_3.Start, Indices=0, Wrap=True)

lng_2 = ListLength(List=cull_i_2)
expression_2 = Expression(x=lng_2, Expression="if((x%2 = 1 ),(x-1),x)")
cull_i_3 = CullIndex(List=cull_i_2, Indices=expression_2, Wrap=False)

dispatch_3 = Dispatch(List=cull_i, DispatchPattern=[False, True])  # -> ListA, ListB
dispatch_4 = Dispatch(List=cull_i_3, DispatchPattern=[False, True])  # -> ListA, ListB
pdecon = Deconstruct(Point=dispatch_3.ListA)  # -> XComponent, YComponent, ZComponent
pdecon_2 = Deconstruct(Point=dispatch_4.ListB)  # -> XComponent, YComponent, ZComponent
pdecon_3 = Deconstruct(Point=dispatch_3.ListB)  # -> XComponent, YComponent, ZComponent
pdecon_4 = Deconstruct(Point=dispatch_4.ListA)  # -> XComponent, YComponent, ZComponent
vec = VectorXYZ(XComponent=pdecon_4.XComponent, YComponent=pdecon_4.YComponent, ZComponent=num_3)  # -> Vector, Length
vec_2 = VectorXYZ(XComponent=pdecon_2.XComponent, YComponent=pdecon_2.YComponent, ZComponent=num_3)  # -> Vector, Length
vec_3 = VectorXYZ(XComponent=pdecon.XComponent, YComponent=pdecon.YComponent, ZComponent=num_3)  # -> Vector, Length
vec_4 = VectorXYZ(XComponent=pdecon_3.XComponent, YComponent=pdecon_3.YComponent, ZComponent=num_3)  # -> Vector, Length
ln = Line(StartPoint=vec.Vector, EndPoint=dispatch_4.ListA)
ln_2 = Line(StartPoint=vec_2.Vector, EndPoint=dispatch_4.ListB)
ln_3 = Line(StartPoint=vec.Vector, EndPoint=vec_2.Vector)
ln_4 = Line(StartPoint=vec_4.Vector, EndPoint=dispatch_3.ListB)
ln_5 = Line(StartPoint=vec_3.Vector, EndPoint=dispatch_3.ListA)
ln_6 = Line(StartPoint=vec_3.Vector, EndPoint=vec_4.Vector)
join_2 = JoinCurves(Curves=[ln, ln_2, ln_3], Preserve=False)  # -> flatten(Curves)
join_3 = JoinCurves(Curves=[ln_5, ln_4, ln_6], Preserve=False)  # -> flatten(Curves)
join_4 = JoinCurves(Curves=[sort.ValuesA, join_3, join_2], Preserve=False)  # -> flatten(Curves)
crv_4 = Curve(join_4)
end_4 = EndPoints(Curve=crv_4)  # -> Start, End
line = LineSDL(Start=end_4.End, Direction=Z, Length=Z)
line_2 = LineSDL(Start=end_4.Start, Direction=Z, Length=Z)

join_5 = JoinCurves(Curves=[crv_4, line, line_2], Preserve=False)
end_5 = EndPoints(Curve=join_5)  # -> Start, End

C = ClusterOutput(join_5)
S = ClusterOutput(end_5.Start)
E = ClusterOutput(end_5.End)
