# Grasshopper definition user_curve_finish.gh (Grasshopper 1.0.7)

# ----
# Click to save
button = Button()

# ----
# Click to preview path
toggle = BooleanToggle(True)

# ----
# Set Z axis safe offset:
z_safe_mm = Slider(6, range=1..10)

# ----
# Select your tool diameter:
value_list = ValueList({"1/4''": 6.35, "1/8''": 3.175, "6mm": 6, "8mm": 8}, selected="1/4''")

# ----
# Select your tool diameter:
overlap = Slider(50, range=20..90)

# ----
# Set cut speed parameters:
retract_speed_mm_sec = Slider(700, range=100..1000)
cut_speed_mm_sec = Slider(1600, range=100..2000)
engage_speed_mm_sec = Slider(700, range=100..1000)

# ----
# Select your design:
# Right click on 'Brep'->Set One Brep
brep = Brep(<brep referenced from the Rhino model>)

# ----
# Select your pattern:
# Right click on 'Crv'->Set One Curve
# Or:
# Right click on 'Crv'->Set Multiple Curvs
crv = Curve(<curve referenced from the Rhino model>)

# ----
# User Curve Finish Program
cluster = Cluster(brep=brep, crv=crv, x=value_list, y=overlap, num=cut_speed_mm_sec, safe_z=z_safe_mm, save=button, preview=toggle)

# ==== cluster Cluster
brep = ClusterInput()
crv = ClusterInput()
brep_2 = Brep(brep)
x = ClusterInput()
y = ClusterInput()
num = ClusterInput()
crv_2 = Curve(crv)

# ----
# toolD calc
expression = Expression(x=x, y=y, Expression="((100-y)/100)*x")

num_2 = Number(num)
bbox = BoundingBox(Content=crv_2, Plane=PlaneXY(0, 0, 0))  # -> Box, Box_2

bbox_2 = BoundingBox(Content=brep_2, Plane=PlaneXY(0, 0, 0))  # -> Box, Box_2
boxprop = BoxProperties(Box=bbox_2.Box)  # -> Center, Diagonal, Area, Volume, Degeneracy
pdecon = Deconstruct(Point=boxprop.Diagonal)  # -> XComponent, YComponent, ZComponent
expression_2 = Expression(x=pdecon.XComponent, y=pdecon.YComponent, Expression="If(x>y, x*0.55, y*0.55)")

boxprop_2 = BoxProperties(Box=bbox.Box)  # -> Center, Diagonal, Area, Volume, Degeneracy
pdecon_2 = Deconstruct(Point=boxprop.Center)  # -> XComponent, YComponent, ZComponent
multiplication = Multiplication(A=pdecon.YComponent, B=1.1)
subtraction = Subtraction(A=pdecon_2.YComponent, B=multiplication)
vec = VectorXYZ(XComponent=pdecon_2.XComponent, YComponent=subtraction, ZComponent=pdecon_2.ZComponent)  # -> Vector, Length
division = Division(A=expression_2, B=expression)
vec2pt = Vector2Pt(PointA=boxprop_2.Center, PointB=vec.Vector, Unitize=False)  # -> Vector, Length
move = Move(Geometry=crv_2, Motion=vec2pt.Vector)  # -> Geometry, Transform
Y = UnitY(Factor=expression)
multiplication_2 = Multiplication(A=division, B=4)
arrlinear = LinearArray(Geometry=move.Geometry, Direction=Y, Count=multiplication_2)  # -> flatten(Geometry), Transform
safe_z = ClusterInput()
project = Project(Curve=arrlinear.Geometry, Brep=brep_2, Direction=Vector(0, 0, 1))  # -> flatten(Curve)
create_1_gcode_line = Create1GcodeLine(F=safe_z, crv=flatten(project))  # -> C, S, E
post_to = ValueList({"Mach3 mm": 1, "ShopBot inch": 2}, selected="Mach3 mm")
divlength = DivideLength(Curve=create_1_gcode_line.C, Length=1)  # -> Points, Tangents, Parameters
pt = Point(divlength.Points)
preview = ClusterInput()
save = ClusterInput()

pypreview = GhPythonScript(pts=pt, cutSpeed=num_2, preview=preview)  # -> out, crv, s, e, length, time; inputs pts: list, preview: Boolean
# ---------- pypreview: Python ----------
__author__ = "zoran"
__version__ = "2020.08.21"

import rhinoscriptsyntax as rs

if(preview):
    crv=rs.AddPolyline(pts)
    length=int(rs.CurveLength(crv))
    e=rs.CurveEndPoint(crv)
    s=rs.CurveStartPoint(crv)
    time=int(length/cutSpeed)
# ---------- end pypreview ----------
pywritegcode = GhPythonScript(points=pt, save=save, cutSpeed=num_2, post=post_to, safeZ=safe_z)  # -> out, safeZmm, safeZ_inch; inputs points: list of Point3d, save: Boolean
# ---------- pywritegcode: Python ----------
"""Provides a scripting component.
    Inputs:
        points: gcode path as points
        save: bool save or not
        cutSpeed: feedrate in mm/sec (even if shopbotInch)
        filepath: save location
        post: mach3mm/shopBotInch
    Output:
        a: The a output variable"""
                        
import rhinoscriptsyntax as rs
#import os.path
#from os import path 
                
inchFeedrate=str((cutSpeed/60)*0.0393701) #move to inchs/sec
shopBotHeader= "IF %(25)=1 THEN GOTO UNIT_ERROR  \'check to see software is set to standard\n"
shopBotHeader+="SA \'Set program to absolute coordinate mode\n"
shopBotHeader+="CN, 90\n"
shopBotHeader+="&PWSafeZ = 0.300\n"
shopBotHeader+="&PWMaterial = 0.320\n"
shopBotHeader+="&Tool =1     \'Tool number to change to"
shopBotHeader+="C9     \'Change tool\n"
shopBotHeader+="TR,12000    \'Set spindle RPM\n"
shopBotHeader+="C6   \'Spindle on\n"
shopBotHeader+="PAUSE 2\n"
shopBotHeader+="MS,"+inchFeedrate+","+inchFeedrate+"   \t\'sets move speed (feedrate) inch/sec 1st argument is xy speed the 2nd is z speed\n"
shopBotHeader+="JZ,"+str(safeZ*0.0393701)+"   \t\'###jog to safeZ\n"
shopBotHeader+="J2,0.000000,0.000000  \t\'###Jog 2D to origin"                        
shopBotFooter= "JZ,"+str(safeZ*0.0393701)+"\n"
shopBotFooter+= "C7 \t\'Turning router OFF\n"
shopBotFooter+= "END\n"
shopBotFooter+= "UNIT_ERROR:\n"
shopBotFooter+= "CN, 91   'Run file explaining unit error\n"
shopBotFooter+= "END"
                        
mach3Header = "G00 G49 G40.1 G17 G80 G50 G90\n" 
mach3Header+= "G21\n"
mach3Header+= "M6 T0\n"
mach3Header+= "M03 S20000\n"
mach3Header+= "G00 Z"+str(safeZ)+"\n"                       
mach3Footer = "F100\n"
mach3Footer+= "G00 Z"+str(safeZ)+"\n"
mach3Footer+= "M5 M9\n"
mach3Footer+= "M30"
                        
safeZ_inch=safeZ*0.0393701
safeZmm=safeZ                  
minZ_inch=99999
minZmm=99999
                        
shopBot=False #by default post to mach3 mm
if(post=="ShopBot_inch"):
    shopBot=True
                        
                            
if(save):
    s=""
    if(shopBot):
        #filepath+=".sbp"
        s += shopBotHeader+"\n"
        p0=points[0]*0.0393701 #move to inchs
        s += "J3," + str(p0[0])+ ", " + str(p0[1])+ ", " + str(p0[2])+"\n"
        for p in points:
            p=p*0.0393701 #move to inchs
            if(p[2]<minZ_inch): minZ_inch=p[2]
            s += "M3," + str(p[0])+ ", " + str(p[1])+ ", " + str(p[2])+"\n"
                                
        s += shopBotFooter
        filepath = rs.SaveFileName("Save As", "ShopBot Files (*.sbp)|*.sbp|All Files (*.*)|*.*||",filename="ShopBot_userCurveFinish_",extension=".sbp")
        
    else: #mach3 post
        #filepath+=".txt"
        s += mach3Header+"\n"
        s += "G01 Z"+str(safeZ)+"  F" + str(cutSpeed) +"\n"
        for p in points:
            if(p[2]<minZmm): minZmm=p[2]
            s += "X" + str(p[0]) + " Y" + str(p[1]) + " Z" + str(p[2])+"\n"
                                
        s += mach3Footer
        
        filepath = rs.SaveFileName("Save As", "Text Files (*.txt)|*.txt|All Files (*.*)|*.*||",filename="Mach3_userCurveFinish_",extension=".txt")
                        
                            
                           
    
    #filepath = rs.OpenFileName("Save As", "Text Files (*.txt)|*.txt|All Files (*.*)|*.*||",filename=" mach3_horizontal_rough_",extension=".txt")
    f=open(filepath,"w")
    f.write(s)
    f.close()
    a="all went ok!"        
                        
                
else: 
    a="save is disabled- nothing saved"
# ---------- end pywritegcode ----------
panel = Panel(pywritegcode.safeZ_inch)
panel_2 = Panel(pywritegcode.safeZmm)

# ==== cluster Create1GcodeLine
crv = ClusterInput()
crv_2 = Curve(crv)
F = ClusterInput()
Z = UnitZ(Factor=F)
Z_2 = UnitZ(Factor=F)

# ----
# if curve is closed break
# it to get a seperate start
#  and end
cls = Closed(Curve=crv_2)  # -> Closed, Periodic
dispatch = Dispatch(List=crv_2, DispatchPattern=cls.Closed)  # -> ListA, ListB

# ----
# if curve end points are too close
# seperate start  and end a bit
end = EndPoints(Curve=dispatch.ListB)  # -> Start, End
vec2pt = Vector2Pt(PointA=end.Start, PointB=end.End, Unitize=False)  # -> Vector, Length
smaller = SmallerThan(FirstNumber=vec2pt.Length, SecondNumber=0.002)  # -> SmallerThan, OrEqualTo
dispatch_2 = Dispatch(List=dispatch.ListB, DispatchPattern=smaller.OrEqualTo)  # -> ListA, ListB

ext = ExtendCurve(Curve=[dispatch_2.ListA, dispatch.ListA], Type=0, Start=0, End=-0.002)

crv_3 = Curve([ext, dispatch_2.ListB])
join = JoinCurves(Curves=crv_3, Preserve=False)
end_2 = EndPoints(Curve=join)  # -> Start, End
devec = DeconstructVector(Vector=end_2.Start)  # -> XComponent, YComponent, ZComponent
sort = SortList(Keys=devec.YComponent, ValuesA=join)  # -> Keys, flatten(ValuesA)
end_3 = EndPoints(Curve=sort.ValuesA)  # -> Start, End

lng = ListLength(List=end_3.End)
expression = Expression(x=lng, Expression="if((x%2 = 1 ),(x-1),x)")
cull_i = CullIndex(List=end_3.End, Indices=expression, Wrap=False)

cull_i_2 = CullIndex(List=end_3.Start, Indices=0, Wrap=True)

lng_2 = ListLength(List=cull_i_2)
expression_2 = Expression(x=lng_2, Expression="if((x%2 = 1 ),(x-1),x)")
cull_i_3 = CullIndex(List=cull_i_2, Indices=expression_2, Wrap=False)

dispatch_3 = Dispatch(List=cull_i, DispatchPattern=[False, True])  # -> ListA, ListB
dispatch_4 = Dispatch(List=cull_i_3, DispatchPattern=[False, True])  # -> ListA, ListB
ln = Line(StartPoint=dispatch_4.ListA, EndPoint=dispatch_4.ListB)
ln_2 = Line(StartPoint=dispatch_3.ListA, EndPoint=dispatch_3.ListB)
move = Move(Geometry=dispatch_4.ListA, Motion=Z)  # -> Geometry, Transform
move_2 = Move(Geometry=dispatch_4.ListB, Motion=Z)  # -> Geometry, Transform
move_3 = Move(Geometry=ln, Motion=Z)  # -> Geometry, Transform
move_4 = Move(Geometry=dispatch_3.ListB, Motion=Z)  # -> Geometry, Transform
move_5 = Move(Geometry=dispatch_3.ListA, Motion=Z)  # -> Geometry, Transform
move_6 = Move(Geometry=ln_2, Motion=Z)  # -> Geometry, Transform
ln_3 = Line(StartPoint=move.Geometry, EndPoint=dispatch_4.ListA)
ln_4 = Line(StartPoint=move_2.Geometry, EndPoint=dispatch_4.ListB)
ln_5 = Line(StartPoint=move_5.Geometry, EndPoint=dispatch_3.ListA)
ln_6 = Line(StartPoint=move_4.Geometry, EndPoint=dispatch_3.ListB)
join_2 = JoinCurves(Curves=[move_3.Geometry, ln_3, ln_4], Preserve=False)  # -> flatten(Curves)
join_3 = JoinCurves(Curves=[ln_5, ln_6, move_6.Geometry], Preserve=False)  # -> flatten(Curves)
join_4 = JoinCurves(Curves=[sort.ValuesA, join_3, join_2], Preserve=False)  # -> flatten(Curves)
crv_4 = Curve(join_4)
end_4 = EndPoints(Curve=crv_4)  # -> Start, End
line = LineSDL(Start=end_4.End, Direction=Z_2, Length=Z_2)
line_2 = LineSDL(Start=end_4.Start, Direction=Z_2, Length=Z_2)

join_5 = JoinCurves(Curves=[crv_4, line, line_2], Preserve=False)
end_5 = EndPoints(Curve=join_5)  # -> Start, End

S = ClusterOutput(end_5.Start)
E = ClusterOutput(end_5.End)
C = ClusterOutput(join_5)
