# Grasshopper definition rough_cut.gh (Grasshopper 1.0.7)

# ----
# Click to save
button = Button()

# ----
# Set cut speed:
cut_speed = Slider(995, range=200..2000)

# ----
# Click to preview path
toggle = BooleanToggle(True)

# ----
# Set Z axis safe offset:
z_safe_mm = Slider(4, range=1..10)

# ----
# Select your tool diameter:
list = ValueList({"1/4''": 6.35, "1/8''": 3.175, "6mm": 6, "8mm": 8}, selected="1/4''")

# ----
# Set overlap (suggested 50%):
overlap = Slider(40, range=20..60)

# ----
# Set the distance between layers:
step_down_mm = Slider(6, range=6..12)

# ----
# Select your design:
# Right click on 'Brep'->Set One Brep
brep = Brep(<brep referenced from the Rhino model>)

# ----
# Rough Cut Program
# connection line on bowl edge
program = Program(
    brep=brep,
    overlap=overlap,
    diameter=list,
    offset=step_down_mm,
    zsafe=z_safe_mm,
    cutspeed=cut_speed,
    previewpath=toggle,
    savegcode=button)

# ==== cluster Program
brep = ClusterInput()  # Input Brep
diameter = ClusterInput()
overlap = ClusterInput()
offset = ClusterInput()  # How many cm to keep
zsafe = ClusterInput()
cutspeed = ClusterInput()  # CutSpeed
previewpath = ClusterInput()  # PreviewPath
savegcode = ClusterInput()  # SaveGCODE
panel = Panel(brep)

# ----
# Bounding Box
bbox = BoundingBox(Content=brep, Plane=PlaneXY(0, 0, 0))  # -> Box, Box_2
debrep = DeconstructBrep(Brep=bbox.Box)  # -> Faces, Edges, Vertices
bb_y_width = ListItem(List=debrep.Edges, Index=expr("3", 0), Wrap=True)
bb_height = ListItem(List=debrep.Edges, Index=8, Wrap=True)
bb_x_width = ListItem(List=debrep.Edges, Index=2, Wrap=True)
bb_top_plane = ListItem(List=debrep.Faces, Index=5, Wrap=True)

# ----
# Calculate layers amount
min_pt_dis_mm = Slider(1, range=1..5)
len = Length(Curve=bb_height)
python = GhPythonScript(box_length=len, min_pt_dis=min_pt_dis_mm, offset=offset)  # -> a
# ---------- python: Python ----------
"""Provides a scripting component.
    Inputs:
        box_length: Bounding box length
        min_pt_dis: Distance from minimum point
        offset: Offset between each step.
    Output:
        a: Number of steps."""

__author__ = "Yitzchak Vaknin"
__version__ = "2020.03.13"

import rhinoscriptsyntax as rs

# Constants:
DEFAULT_Y_PERCENT = 20

# if min_pt_dis value is greater than box_length
# the min_pt_dis value set to 20 percent of the box_length.  
if min_pt_dis > box_length:
    min_pt_dis = box_length * (DEFAULT_Y_PERCENT / 100)

a = round((box_length - min_pt_dis) / offset)
print(box_length)
# ---------- end python ----------

# ----
# Direction
Z = UnitZ(Factor=offset)
rev = Reverse(Vector=Z)

# ----
# Calculate Z safe
area = Area(Geometry=bb_top_plane)  # -> Area, Centroid
devec = DeconstructVector(Vector=area.Centroid)  # -> XComponent, YComponent, ZComponent
addition = Addition(A=zsafe, B=devec.ZComponent)

arrlinear = LinearArray(Geometry=bb_top_plane, Direction=rev, Count=python)  # -> Geometry, Transform
brep_2 = Brep(brep)

# ----
# Calculate grid parameters
len_2 = Length(Curve=bb_x_width)
len_3 = Length(Curve=bb_y_width)
python_2 = GhPythonScript(diameter=diameter, overlap=overlap, x_box_length=len_2, y_box_length=len_3)  # -> grid_interval, u_div, v_div
# ---------- python_2: Python ----------
"""Provides a scripting component.
    Inputs:
        diameter: millimeter
        overlap: percentage
        x_box_length: bounding box x axis length
        y_box_length: bounding box y axis length
    Output:
        grid_interval: disance between point on grid (cm)
        u_div: divisions in the surfave U direction
        v_div: divisions in the surfave V direction"""

__author__ = "Yitzchak Vaknin"
__version__ = "2020.09.29"

import rhinoscriptsyntax as rs

grid_interval = diameter * ((100-overlap) / 100)
u_div = round(x_box_length / grid_interval)
v_div = round(y_box_length / grid_interval)
# ---------- end python_2 ----------
sdivide = DivideSurface(Surface=bb_top_plane, UCount=python_2.u_div, VCount=python_2.v_div)  # -> flatten(Points), Normals, Parameters

# ----
# Python: extract each layer edges
python_3 = GhPythonScript(brep=brep_2, planes_array=arrlinear.Geometry)  # -> edges, flatten(parts), debug; inputs planes_array: list
# ---------- python_3: Python ----------
__author__ = "Yitzchak Vaknin"
__version__ = "2020.09.29"

import rhinoscriptsyntax as rs
import Grasshopper as gh

def main():
    plane_parts = list()
    plane_edges = list()
    planes = planes_array[1:]
    for i in range(len(planes)):
        intersection_result = rs.BooleanIntersection(brep, planes[i], delete_input=False)
        if(intersection_result):
            plane_parts.append(intersection_result)
            plane_edges.append(rs.DuplicateEdgeCurves(intersection_result[0]))
#        if(intersection_result):
#            if(len(intersection_result) == 1):
#                plane_parts.append(intersection_result)
#                plane_edges.append(rs.DuplicateEdgeCurves(intersection_result))
#            else:
#                for val in intersection_result:
#                    plane_parts.append([val])
#                    plane_edges.append(rs.DuplicateEdgeCurves(val))
##                tempDiff = rs.BooleanDifference(planes[i],intersection_result, delete_input=False) 
##                plane_parts.append(tempDiff)
##                plane_edges.append(rs.DuplicateEdgeCurves(tempDiff))
#        print(plane_parts)
    return plane_edges, plane_parts

def listToTree(nestedList):
    """Convert a nested python iterable to a datatree."""
    dt = gh.DataTree[object]()
    for i,l in enumerate(nestedList):
        dt.AddRange(l,gh.Kernel.Data.GH_Path(i))
    return dt

edges, parts = main()
edges = listToTree(edges)
parts = listToTree(parts)
# ---------- end python_3 ----------
viewer = ParamViewer(python_3.edges)

# ----
# Fit ArrayLinear tree depth
# to python's component output
cull_i = CullIndex(List=arrlinear.Geometry, Indices=0, Wrap=True)  # -> simplify(graft(List))
viewer_2 = ParamViewer(cull_i)
lng = ListLength(List=viewer_2)

# ----
# Filter relevent points
python_4 = GhPythonScript(grid=sdivide.Points, brep=brep, plane=cull_i)  # -> simplify(a); inputs grid: list
# ---------- python_4: Python ----------
__author__ = "Yitzchak Vaknin"
__version__ = "2020.09.29"

import rhinoscriptsyntax as rs

Z_INDEX = 2

def trim_float(num):
    """Trim float to a number with 3 digits after point."""
    return float(format(num, '.3f'))

def main():
    res = list()
    points = [rs.PointCoordinates(pt) for pt in grid]
    for pt in points:
        prj_plane = rs.ProjectPointToSurface(pt, plane, (0,0,-1))
        prj_brep = rs.ProjectPointToSurface(pt, brep, (0,0,-1))
        if len(prj_brep) == 1 and (trim_float(prj_brep[0][Z_INDEX]) < trim_float(prj_plane[0][Z_INDEX])):
            res.append(prj_plane[0])
    return res

a = main()
# ---------- end python_4 ----------
viewer_3 = ParamViewer(python_4)

# ----
# Debugger
number_slider = Slider(1, range=0..20)  # disabled
number_slider_2 = Slider(0, range=-400..400)  # disabled
item = ListItem(Index=number_slider, Wrap=True)  # disabled
Y = UnitY(Factor=number_slider_2)
move = Move(Geometry=item, Motion=Y)  # -> Geometry, Transform; disabled
X = UnitX(Factor=number_slider_2)  # disabled

# ----
# Safe distance from edges (intervel grid X multiplier)
number_slider_3 = Slider(1, range=1..5)
multiplication = Multiplication(A=python_2.grid_interval, B=number_slider_3)

# ----
# Remove points that to close to the edges
pull = PullPoint(Point=python_4, Geometry=python_3.edges, ClosestOnly=True)  # -> ClosestPoint, Distance
larger = LargerThan(FirstNumber=pull.Distance, SecondNumber=number_slider_3)  # -> LargerThan, OrEqualTo
cull = CullPattern(List=python_4, CullPattern=larger.OrEqualTo)

# ----
# Create path and returns points list.
# Lines apperas only for debug (use list item to navigate in order)
python_5 = GhPythonScript(grid_interval=python_2.grid_interval, points_lst=cull, z_safe=addition, edges=python_3.edges)  # -> flatten(lines), simplify(flatten(points)), connected_lines, z_safe_lines; inputs points_lst: list, edges: list
# ---------- python_5: Python ----------
"""Provides a scripting component.
    Inputs:
        grid_interval: The distance between 2 points on the grid.
        points_lst: Relevent points
        z_safe: z safe value
    Output:
        points: Points on path
        lines: main lines
        connected_lines: lines between main lines with same z value 
        z_safe_lines: lines connected through z safe"""

__author__ = "Yitzchak Vaknin"
__version__ = "2020.04.21"

import rhinoscriptsyntax as rs
from scriptcontext import sticky
import Grasshopper as gh

# Constants:
 
X_INDEX = 0
Y_INDEX = 1

# Globals:
lines_list = list()
z_safe_lines = list()
connected_lines = list()
points_list = list()
tupels_list = list() # accumulate points as tuples - 1 or 2 points in tuple


def connect_through_z_safe(pt1, pt2):
    temp1 = rs.AddPoint((pt1[0], pt1[1], z_safe))
    points_list.append(temp1)
    z_safe_lines.append(rs.AddInterpCurve([pt1, temp1]))
    temp2 = rs.AddPoint((pt2[0], pt2[1], z_safe))
    points_list.append(temp2)
    z_safe_lines.append(rs.AddInterpCurve([temp1, temp2]))
    z_safe_lines.append(rs.AddInterpCurve([temp2, pt2]))


def connect_lines(tpl1, tpl2, lastToLast):
    pt1 = tpl1[0]
    pt2 = tpl2[0]
    if lastToLast:
        if tpl1[1] != None:
            pt1 = tpl1[1]
        if len(tpl2) == 2:
            pt2 = tpl2[1]
    if abs(pt1[Y_INDEX] - pt2[Y_INDEX]) >= (grid_interval+0.01):
        connect_through_z_safe(pt1, pt2)
        return
    if (pt1[X_INDEX] == pt2[X_INDEX]) and (pt1[Y_INDEX] == pt2[Y_INDEX]):
        return 
    temp_curve = rs.AddInterpCurve([pt1, pt2])
    res = False
    for crv in edges:
        res = rs.CurveCurveIntersection(temp_curve, crv)
        if res: break
    if not res:
        connected_lines.append(temp_curve)
    else:
        connect_through_z_safe(pt1, pt2)


def append_pts_in_order(lastToLast, cur_tuple):
    if lastToLast:
        points_list.append(cur_tuple[1])
        points_list.append(cur_tuple[0])
        return False
    else:
        points_list.append(cur_tuple[0])
        points_list.append(cur_tuple[1])
        return True

def create_start_and_end_lines(is_start):
    pt1 = rs.PointCoordinates(points_lst[0]) if is_start else rs.PointCoordinates(points_lst[len(points_lst) - 1])
    temp1 = rs.AddPoint((pt1[0], pt1[1], z_safe))
    points_list.append(temp1)
    if is_start:
        z_safe_lines.append(rs.AddInterpCurve([temp1, pt1]))
    else:
        z_safe_lines.append(rs.AddInterpCurve([pt1, temp1]))

def create_lines():
    cur_tuple = [] # flag to now if we need to accumulate the first point
    lastToLast = False
    last_tuple = [None, None] # accumulate last curve points
    if len(points_lst): create_start_and_end_lines(True)
    for i in range(len(points_lst) - 1):
        
        pt1 = rs.PointCoordinates(points_lst[i])
        pt2 = rs.PointCoordinates(points_lst[i+1])
        # copmare disatnce bwtween 2 points:
        if abs(pt1[Y_INDEX] - pt2[Y_INDEX]) <= (grid_interval+0.1):
            if not cur_tuple: 
                cur_tuple.append(pt1)
        else:
            if cur_tuple:
                cur_tuple.append(pt1)
                lines_list.append(rs.AddInterpCurve(cur_tuple))
                if last_tuple[0] != None:
                    connect_lines(last_tuple, cur_tuple, lastToLast)
                lastToLast = append_pts_in_order(lastToLast, cur_tuple)
                last_tuple[0], last_tuple[1] = cur_tuple[0], cur_tuple[1]
                cur_tuple = list()
            else:
                if last_tuple[0] != None:
                    connect_lines(last_tuple, [pt1], lastToLast)
                points_list.append(pt1)
                last_tuple = [pt1, None]
#     last line:
    if cur_tuple:
        cur_tuple.append(rs.PointCoordinates(points_lst[len(points_lst) - 1]))
        lines_list.append(rs.AddInterpCurve(cur_tuple))
        if last_tuple[0] != None:
            connect_lines(last_tuple, cur_tuple, lastToLast)
        lastToLast = append_pts_in_order(lastToLast, cur_tuple)
    else:
        if last_tuple[0] != None:
            connect_lines(last_tuple, [pt1], lastToLast)
        points_list.append(pt1)
    if len(points_lst): create_start_and_end_lines(False)
    return points_list, lines_list, connected_lines, z_safe_lines

points, lines, connected_lines, z_safe_lines = create_lines()
# ---------- end python_5 ----------
connected_lines = Curve(python_5.connected_lines)
z_safe_lines = Curve(python_5.z_safe_lines)
lines = Curve(python_5.lines)
pt = Point(python_5.points)
viewer_4 = ParamViewer(python_5.points)

# ----
# Save G-Code
post_to = ValueList({"Mach3 mm": "Mach3_mm", "ShopBot inch": "ShopBot_inch"}, selected="Mach3 mm")
pywritegcode = GhPythonScript(points=python_5.points, save=savegcode, cutSpeed=cutspeed, post=post_to, safeZ=zsafe)  # -> a; inputs points: list of Point3d, save: Boolean
# ---------- pywritegcode: Python ----------
"""Provides a scripting component.
    Inputs:
        points: gcode path as points
        save: bool save or not
        cutSpeed: feedrate in mm/sec (even if shopbotInch)
        filepath: save location
        post: mach3mm/shopBotInch
    Output:
        a: The a output variable"""
                        
import rhinoscriptsyntax as rs
from datetime import datetime
#import os.path
#from os import path 
                
inchFeedrate=str((cutSpeed/60)*0.0393701) #move to inchs/sec
shopBotHeader= "IF %(25)=1 THEN GOTO UNIT_ERROR  \'check to see software is set to standard\n"
shopBotHeader+="SA \'Set program to absolute coordinate mode\n"
shopBotHeader+="CN, 90\n"
shopBotHeader+="&PWSafeZ = 0.300\n"
shopBotHeader+="&PWMaterial = 0.320\n"
shopBotHeader+="&Tool =1     \'Tool number to change to"
shopBotHeader+="C9     \'Change tool\n"
shopBotHeader+="TR,12000    \'Set spindle RPM\n"
shopBotHeader+="C6   \'Spindle on\n"
shopBotHeader+="PAUSE 2\n"
shopBotHeader+="MS,"+inchFeedrate+","+inchFeedrate+"   \t\'sets move speed (feedrate) inch/sec 1st argument is xy speed the 2nd is z speed\n"
shopBotHeader+="JZ,"+str(safeZ*0.0393701)+"   \t\'###jog to safeZ\n"
shopBotHeader+="J2,0.000000,0.000000  \t\'###Jog 2D to origin"                        
shopBotFooter= "JZ,"+str(safeZ*0.0393701)+"\n"
shopBotFooter+= "C7 \t\'Turning router OFF\n"
shopBotFooter+= "END\n"
shopBotFooter+= "UNIT_ERROR:\n"
shopBotFooter+= "CN, 91   'Run file explaining unit error\n"
shopBotFooter+= "END"
                        
mach3Header = "G00 G49 G40.1 G17 G80 G50 G90\n" 
mach3Header+= "G21\n"
mach3Header+= "M6 T0\n"
mach3Header+= "M03 S20000\n"
mach3Header+= "G00 Z"+str(safeZ)+"\n"                       
mach3Footer = "F100\n"
mach3Footer+= "G00 Z"+str(safeZ)+"\n"
mach3Footer+= "M5 M9\n"
mach3Footer+= "M30"
                        
                        
                        
shopBot=False #by default post to mach3 mm
if(post=="ShopBot_inch"):
    shopBot=True
                        
                            
if(save):
    timestamp = datetime.now().strftime("%d-%b-%Y_%H-%M-%S")
    s=""
    if(shopBot):
        #filepath+=".sbp"
        s += shopBotHeader+"\n"
        p0=points[0]*0.0393701 #move to inchs
        s += "J3," + str(p0[0])+ ", " + str(p0[1])+ ", " + str(p0[2])+"\n"
        for p in points:
            p=p*0.0393701 #move to inchs
            s += "M3," + str(p[0])+ ", " + str(p[1])+ ", " + str(p[2])+"\n"
                                
        s += shopBotFooter
        filepath = rs.OpenFileName("Save As", "ShopBot Files (*.sbp)|*.sbp|All Files (*.*)|*.*||",filename="ShopBot_horizontal_rough_" + timestamp,extension=".sbp")
        
    else: #mach3 post
        #filepath+=".txt"
        s += mach3Header+"\n"
        s += "G01 Z0.5  F" + str(cutSpeed) +"\n"
        for p in points:
            s += "X" + str(p[0]) + " Y" + str(p[1]) + " Z" + str(p[2])+"\n"
                                
        s += mach3Footer
        
        filepath = rs.OpenFileName("Save As", "Text Files (*.txt)|*.txt|All Files (*.*)|*.*||",filename="Mach3_horizontal_rough_" + timestamp,extension=".txt")
                        
                            
                           
    
    #filepath = rs.OpenFileName("Save As", "Text Files (*.txt)|*.txt|All Files (*.*)|*.*||",filename=" mach3_horizontal_rough_",extension=".txt")
    f=open(filepath,"w+")
    f.write(s)
    f.close()
    a="all went ok!"        
                        
                
else: 
    a="save is disabled- nothing saved"
# ---------- end pywritegcode ----------

# ----
# Preview Path
pypreview = GhPythonScript(pts=python_5.points, cutSpeed=cutspeed, preview=previewpath)  # -> out, crv, s, e, length, time; inputs pts: list, preview: Boolean
# ---------- pypreview: Python ----------
__author__ = "zoran"
__version__ = "2020.08.21"

import rhinoscriptsyntax as rs

if(preview):
    crv=rs.AddPolyline(pts)
    length=int(rs.CurveLength(crv))
    e=rs.CurveEndPoint(crv)
    s=rs.CurveStartPoint(crv)
    time=int(length/cutSpeed)
# ---------- end pypreview ----------
total_length_mm = Panel(pypreview.length)
estimated_time_min = Panel(pypreview.time)
